# Grasshopper definition 15.04.08 INVOLUTE GEAR GENERATOR.gh (Grasshopper 0.9.76)

origin = ConstructPoint(XCoordinate=0, YCoordinate=0, ZCoordinate=0)
tip_diameter = Slider(3, range=0..50)
root_diameter = Slider(2.5, range=0..50)
number_of_teeth = Slider(30, range=0..100)
angle_of_escapement = Slider(90, range=0..180)
escapement_hub_offset = Slider(0.5, range=0..1)
impulse_angle_of_pallet = Slider(2, range=0..5)
lock_angle_of_pallet = Slider(1, range=0..5)
pitch_diameter = Slider(6, range=0..100)
pressure_angle = Slider(20, range=0..90)
hub_diameter = Slider(0.86, range=0..1)
number_of_teeth_2 = Slider(60, range=0..100)
origin_2 = ConstructPoint(XCoordinate=0, YCoordinate=0, ZCoordinate=0)
involute_gear_generator = INVOLUTEGEARGENERATOR(
    origin=origin_2,
    pitch_diameter=pitch_diameter,
    number_of_teeth=number_of_teeth_2,
    pressure_angle=pressure_angle,
    hub_diameter=hub_diameter)  # -> C, C_2, C_3, C_4
hub = Curve(involute_gear_generator.C)
pitch_circle = Curve(involute_gear_generator.C_2)
spur_rack = Curve(involute_gear_generator.C_3)
involute_gear = Curve(involute_gear_generator.C_4)
cluster = Cluster(
    escape_wheel_hub=origin,
    hub_diameter_of_escape_wheel=hub_diameter,
    tip_diameter_of_escape_wheel=tip_diameter,
    root_diameter_of_escape_wheel=root_diameter,
    escape_wheel_number_of_teeth=number_of_teeth,
    angle_of_escapement=angle_of_escapement,
    escapement_hub_diameter=hub_diameter,
    escapement_hub_offset=escapement_hub_offset,
    lock_angle_of_pallet=lock_angle_of_pallet,
    impulse_angle_of_pallet=impulse_angle_of_pallet)  # -> C_2, C, C_3, C_5, C_6, L_2, L, C_4
crv = Curve([hub, pitch_circle, involute_gear])
arbor_curves = Curve([cluster.C_2, cluster.C_3])
impulse_faces = Curve([cluster.L_2, cluster.L])
resting_faces = Curve([cluster.C_5, cluster.C_6])
escape_wheel_teeth = Curve(cluster.C_4)
escape_wheel_hub = Curve(cluster.C)
crv_2 = Curve([resting_faces, impulse_faces, arbor_curves])
crv_3 = Curve([escape_wheel_teeth, escape_wheel_hub])

# ==== cluster INVOLUTEGEARGENERATOR
origin = ClusterInput()
hub_diameter = ClusterInput()
pitch_diameter = ClusterInput()
number_of_teeth = ClusterInput()
pressure_angle = ClusterInput()
origin_2 = Point(origin)
hub_diameter_2 = Number(hub_diameter)
pitch_diameter_2 = Number(pitch_diameter)
number_of_teeth_2 = Number(number_of_teeth)
pressure_angle_2 = Number(pressure_angle)

# ---- group: CONSTANTS CALCULATIONS
# BASE CIRCLE DIAMETER = Pitch Diameter * (Cos(Pressure Angle))
rad = Radians(Degrees=pressure_angle_2)
cos = Cosine(Value=rad)
multiplication = Multiplication(A=pitch_diameter_2, B=cos)
division = Division(A=multiplication, B=2)
circle = CircleCNR(Center=origin_2, Normal=Vector(0, 0, 1), Radius=division)

# ----
division_2 = Division(A=hub_diameter_2, B=2)

# ---- group: CONSTANTS CALCULATIONS / PITCH CIRCLE + DIAMETRAL PITCH
# DIAMETRAL PITCH
# Number of Teeth = Diametral Pitch x Pitch Diameter
# N = P * D
# N / D = P
division_3 = Division(A=pitch_diameter_2, B=2)
division_4 = Division(A=number_of_teeth_2, B=pitch_diameter_2)
pitch_circle = CircleCNR(Center=origin_2, Normal=Vector(0, 0, 1), Radius=division_3)
diametral_pitch = Number(division_4)
divide = DivideCurve(Curve=pitch_circle, Count=number_of_teeth_2, Kinks=False)  # -> Points, Tangents, Parameters

# ---- group: CONSTANTS CALCULATIONS / OUTSIDE DIAMETER
# OUTSIDE DIAMETER (AMERICAN STANDARD SUB TEETH)
# Doutside = (Number of Teeth + 1.6) / Diametral Pitch
number = Number(1.6)
addition = Addition(A=number_of_teeth_2, B=number)
division_5 = Division(A=addition, B=diametral_pitch)
division_6 = Division(A=division_5, B=2)
circle_2 = CircleCNR(Center=origin_2, Normal=Vector(0, 0, 1), Radius=division_6)

# ---- group: CONSTANTS CALCULATIONS / CIRCULAR TOOTH THICKNESS
# CIRCULAR TOOTH THICKNESS
# t = 1.5708 / Diametral Pitch
pi = Pi(Factor=0.5)
division_7 = Division(A=pi, B=diametral_pitch)

# ---- group: CONSTANTS CALCULATIONS / ROOT DIAMETER
# ROOT DIAMETER
# Dr = (Number of Teeth - 2.5) / Diametral Pitch
b = B(2.5)
subtraction = Subtraction(A=number_of_teeth_2, B=b)
division_8 = Division(A=subtraction, B=diametral_pitch)
division_9 = Division(A=division_8, B=2)
circle_3 = CircleCNR(Center=origin_2, Normal=Vector(0, 0, 1), Radius=division_9)

# ---- group: CONSTANTS CALCULATIONS / ADDENDUM
division_10 = Division(A=1, B=diametral_pitch)
panel = Panel("""ADDENDUM
a = 1.000 / Diametral Pitch""")

# ---- group: CONSTANTS CALCULATIONS / DEDENDUM
division_11 = Division(A=1.25, B=diametral_pitch)
panel_2 = Panel("""DEDENDUM
b = 1.250 / Diametral Pitch""")

# ---- group: CONSTANTS CALCULATIONS / WORKING DEPTH
# WORKING DEPTH
# hk = 2.000 / Diametral Pitch
division_12 = Division(A=2, B=diametral_pitch)

# ---- group: CONSTANTS CALCULATIONS / WHOLE DEPTH
# WHOLE DEPTH
# ht = 2.250 / Diametral Pitch
division_13 = Division(A=2.25, B=diametral_pitch)

# ---- group: CONSTANTS CALCULATIONS / CLEARANCE
division_14 = Division(A=2.25, B=diametral_pitch)
panel_3 = Panel("""CLEARANCE
c = .250 / Diametral Pitch""")

# ---- group: CONSTANTS CALCULATIONS / FILLET RADIUS
# FILLET RADIUS (RACK)
# rf = .300 / Diametral Pitch
division_15 = Division(A=0.3, B=diametral_pitch)

# ----
circle_4 = CircleCNR(Center=origin_2, Normal=Vector(0, 0, 1), Radius=division_2)
C = ClusterOutput(circle_4)

# ---- group: CONSTANTS CALCULATIONS
division_16 = Division(A=division_7, B=2)

# ----
C_2 = ClusterOutput(pitch_circle)

# ---- group: CONSTRUCT INVOLUTE CURVE
pitch_circle_2 = Curve(pitch_circle)
base_circle = Curve(circle)
number_slider = Slider(150, range=0..200)
division_17 = Division(A=multiplication, B=1)
division_18 = Division(A=division_17, B=number_slider)
series = Series(Start=division_18, Step=division_18, Count=number_slider)
divlength = DivideLength(Curve=base_circle, Length=graft(series))  # -> Points, Tangents, Parameters
item = ListItem(List=divlength.Points, Index=1, Wrap=True)  # -> flatten(Item)
crv_cp = CurveClosestPoint(Point=item, Curve=base_circle)  # -> Point, Parameter, Distance
eval = EvaluateCurve(Curve=base_circle, Parameter=crv_cp.Parameter)  # -> Point, Tangent, Angle
neg = Negative(Value=eval.Tangent)
line = LineSDL(Start=crv_cp.Point, Direction=neg, Length=series)
end = EndPoints(Curve=base_circle)  # -> Start, End
end_2 = EndPoints(Curve=line)  # -> Start, End

# ---- group: CONSTRUCT INVOLUTE CURVE / MIRROR INVOLUTE CURVE
intcrv = Interpolate(Vertices=flatten([end.Start, end_2.End]), Degree=3, Periodic=False, KnotStyle=1)  # -> Curve, Length, Domain
xz = XZPlane(Origin=origin_2)
mirror = Mirror(Geometry=intcrv.Curve, Plane=xz)  # -> Geometry, Transform

# ---- group: MAKE SPUR GEAR
# LENGTH BELOW PITCH DIAMETER
# L1 = b / (Sin(Pressure Angle))
rad_2 = Radians(Degrees=pressure_angle_2)

# LENGTH ABOVE PITCH DIAMETER
# L1 = a / (Sin(Pressure Angle))
rad_3 = Radians(Degrees=pressure_angle_2)

cos_2 = Cosine(Value=rad_2)
cos_3 = Cosine(Value=rad_3)

division_19 = Division(A=division_10, B=cos_3)
line_2 = LineSDL(Start=origin_2, Direction=Vector(0, 0.25, 0), Length=division_19)

division_20 = Division(A=division_11, B=cos_2)
line_3 = LineSDL(Start=origin_2, Direction=Vector(0, -0.5, 0), Length=division_20)

# ---- group: MAKE SPUR GEAR / TOOTH FACES
# CREATE COMPLEMENTARY INTERIOR FACES OF TEETH
join = JoinCurves(Curves=[line_2, line_3], Preserve=False)
rad_4 = Radians(Degrees=pressure_angle_2)
neg_2 = Negative(Value=rad_4)
rotate = Rotate(Geometry=join, Angle=rad_4, Plane=PlaneXY(0, 0, 0))  # -> Geometry, Transform
rotate_2 = Rotate(Geometry=join, Angle=neg_2, Plane=PlaneXY(0, 0, 0))  # -> Geometry, Transform
X = UnitX(Factor=division_16)
X_2 = UnitX(Factor=division_16)
neg_3 = Negative(Value=X)
move = Move(Geometry=rotate.Geometry, Motion=neg_3)  # -> Geometry, Transform
move_2 = Move(Geometry=rotate_2.Geometry, Motion=X_2)  # -> Geometry, Transform

# ---- group: MAKE SPUR GEAR
# CREATE POLYLINE AND ADD FILLET RADIUS
end_3 = EndPoints(Curve=move_2.Geometry)  # -> Start, End
llx = LineLine(Line1=move_2.Geometry, Line2=move.Geometry)  # -> ParamA, ParamB, PointA, PointB
end_4 = EndPoints(Curve=move.Geometry)  # -> Start, End
pline = PolyLine(Vertices=[end_3.End, llx.PointA, end_4.End], Closed=False)
fillet = Fillet(Curve=pline, Radius=division_15)

# ORIENT TEETH PERP TO CIRCLE
vec2pt = Vector2Pt(PointA=origin_2, PointB=divide.Points, Unitize=False)  # -> Vector, Length
move_3 = Move(Geometry=fillet, Motion=vec2pt.Vector)  # -> Geometry, Transform
line_4 = LineSDL(Start=divide.Points, Direction=divide.Tangents, Length=1)
xy = XYPlane(Origin=divide.Points)
flip = FlipCurve(Curve=line_4)  # -> Curve, Flag
align = AlignPlane(Plane=xy, Direction=flip.Curve)  # -> Plane, Angle
orient = Orient(Geometry=move_3.Geometry, Source=xy, Target=align.Plane)  # -> Geometry, Transform

end_5 = EndPoints(Curve=orient.Geometry)  # -> Start, End
shift = ShiftList(List=orient.Geometry, Shift=1, Wrap=True)
end_6 = EndPoints(Curve=shift)  # -> Start, End
ln = Line(StartPoint=end_5.End, EndPoint=end_6.Start)
join_2 = JoinCurves(Curves=flatten([orient.Geometry, ln]), Preserve=False)

# ----
basic_rack_gear = JoinCurves(Curves=flatten([join_2, circle_4]), Preserve=False)
C_3 = ClusterOutput(basic_rack_gear)

# ---- group: CONSTRUCT INVOLUTE CURVE / EVALUATE BASE CURVE FOR CURVE 1 AND 2 LOCATIONS
ccx = CurveCurve(CurveA=pitch_circle_2, CurveB=basic_rack_gear)  # -> Points, ParamsA, ParamsB
cull = CullPattern(List=ccx.Points, CullPattern=[True, False])
cull_2 = CullPattern(List=ccx.Points, CullPattern=[False, True])

# ---- group: ARRAY TEETH / ARRAY INVOLUTE CURVE 2
crv_cp_2 = CurveClosestPoint(Point=cull_2, Curve=pitch_circle_2)  # -> Point, Parameter, Distance
pt = Point(cull_2)
eval_2 = EvaluateCurve(Curve=pitch_circle_2, Parameter=crv_cp_2.Parameter)  # -> Point, Tangent, Angle
line_5 = LineSDL(Start=cull_2, Direction=eval_2.Tangent, Length=1)
xy_2 = XYPlane(Origin=crv_cp_2.Point)
xy_3 = XYPlane(Origin=pt)
rotate_3 = Rotate(Geometry=line_5, Angle=-1.570796327, Plane=xy_2)  # -> Geometry, Transform
align_2 = AlignPlane(Plane=xy_2, Direction=rotate_3.Geometry)  # -> Plane, Angle

# ---- group: ARRAY TEETH / ARRAY INVOLUTE CURVE 1
crv_cp_3 = CurveClosestPoint(Point=cull, Curve=pitch_circle_2)  # -> Point, Parameter, Distance
pt_2 = Point(cull)
eval_3 = EvaluateCurve(Curve=pitch_circle_2, Parameter=crv_cp_3.Parameter)  # -> Point, Tangent, Angle
line_6 = LineSDL(Start=cull, Direction=eval_3.Tangent, Length=1)
xy_4 = XYPlane(Origin=crv_cp_3.Point)
xy_5 = XYPlane(Origin=pt_2)
rotate_4 = Rotate(Geometry=line_6, Angle=-1.570796327, Plane=xy_4)  # -> Geometry, Transform
align_3 = AlignPlane(Plane=xy_4, Direction=rotate_4.Geometry)  # -> Plane, Angle

# ---- group: ARRAY TEETH
ccx_2 = CurveCurve(CurveA=intcrv.Curve, CurveB=pitch_circle_2)  # -> Points, ParamsA, ParamsB
ccx_3 = CurveCurve(CurveA=mirror.Geometry, CurveB=pitch_circle_2)  # -> Points, ParamsA, ParamsB
vec2pt_2 = Vector2Pt(PointA=ccx_2.Points, PointB=cull, Unitize=False)  # -> Vector, Length
vec2pt_3 = Vector2Pt(PointA=ccx_3.Points, PointB=cull_2, Unitize=False)  # -> Vector, Length
move_4 = Move(Geometry=intcrv.Curve, Motion=vec2pt_2.Vector)  # -> Geometry, Transform
move_5 = Move(Geometry=mirror.Geometry, Motion=vec2pt_3.Vector)  # -> Geometry, Transform

# ---- group: ARRAY TEETH / INVOLUTE TEETH
orient_2 = Orient(Geometry=move_4.Geometry, Source=xy_5, Target=align_3.Plane)  # -> flatten(Geometry), Transform
orient_3 = Orient(Geometry=move_5.Geometry, Source=xy_3, Target=align_2.Plane)  # -> flatten(Geometry), Transform

# ---- group: ARRAY TEETH (continued)
ccx_4 = CurveCurve(CurveA=orient_2.Geometry, CurveB=orient_3.Geometry)  # -> Points, ParamsA, ParamsB
crv_cp_4 = CurveClosestPoint(Point=flatten(ccx_4.Points), Curve=orient_2.Geometry)  # -> Point, Parameter, Distance
item_2 = ListItem(List=crv_cp_4.Parameter, Index=0, Wrap=True)
shatter = Shatter(Curve=orient_2.Geometry, Parameters=item_2)
shatter_2 = Shatter(Curve=orient_3.Geometry, Parameters=item_2)
item_3 = ListItem(List=shatter, Index=0, Wrap=True)
item_4 = ListItem(List=shatter_2, Index=0, Wrap=True)
join_3 = JoinCurves(Curves=[item_3, item_4], Preserve=False)  # -> flatten(Curves)
ccx_5 = CurveCurve(CurveA=circle_2, CurveB=join_3)  # -> Points, ParamsA, ParamsB
item_5 = ListItem(List=ccx_5.Points, Index=0, Wrap=True)
item_6 = ListItem(List=ccx_5.Points, Index=1, Wrap=True)
trim = TrimWithRegion(Curve=join_3, Region=circle_2)  # -> Inside, Outside
ln_2 = Line(StartPoint=item_5, EndPoint=item_6)
crv = Curve(trim.Inside)
join_4 = JoinCurves(Curves=[ln_2, crv], Preserve=False)  # -> flatten(Curves)
shift_2 = ShiftList(List=join_4, Shift=1, Wrap=True)
end_7 = EndPoints(Curve=join_4)  # -> Start, End
end_8 = EndPoints(Curve=shift_2)  # -> Start, End
ln_3 = Line(StartPoint=end_7.End, EndPoint=end_8.Start)
join_5 = JoinCurves(Curves=flatten([ln_3, join_4]), Preserve=False)

# ----
C_4 = ClusterOutput(join_5)

# ==== cluster Cluster
escape_wheel_hub = ClusterInput()
escapement_hub_diameter = ClusterInput()
escapement_hub_offset = ClusterInput()
hub_diameter_of_escape_wheel = ClusterInput()
tip_diameter_of_escape_wheel = ClusterInput()
root_diameter_of_escape_wheel = ClusterInput()
escape_wheel_number_of_teeth = ClusterInput()
angle_of_escapement = ClusterInput()
lock_angle_of_pallet = ClusterInput()
impulse_angle_of_pallet = ClusterInput()
escapement_hub_diameter_2 = Number(escapement_hub_diameter)
escapement_hub_offset_2 = Number(escapement_hub_offset)
escape_wheel_hub_2 = Point(escape_wheel_hub)
hub_diameter_of_escape_wheel_2 = Number(hub_diameter_of_escape_wheel)
tip_diameter_of_escape_wheel_2 = Number(tip_diameter_of_escape_wheel)
root_diameter_of_escape_wheel_2 = Number(root_diameter_of_escape_wheel)
escape_wheel_number_of_teeth_2 = Number(escape_wheel_number_of_teeth)
angle_of_escapement_2 = Number(angle_of_escapement)
lock_angle_of_pallet_2 = Number(lock_angle_of_pallet)
impulse_angle_of_pallet_2 = Number(impulse_angle_of_pallet)
xy_plane = XYPlane(Origin=escape_wheel_hub)

# ---- group: TIP DIAMETER
division = Division(A=tip_diameter_of_escape_wheel_2, B=2)
circle = CircleCNR(Center=escape_wheel_hub_2, Normal=Vector(0, 0, 1), Radius=division)

# ---- group: BASE DIAMETER
division_2 = Division(A=root_diameter_of_escape_wheel_2, B=2)
circle_2 = CircleCNR(Center=escape_wheel_hub_2, Normal=Vector(0, 0, 1), Radius=division_2)

# ---- group: INCLUDED ANGLE OF WHEEL TOOTH
_360 = Number(360)
division_3 = Division(A=_360, B=escape_wheel_number_of_teeth_2)

# ---- group: HUB
division_4 = Division(A=hub_diameter_of_escape_wheel_2, B=2)
circle_3 = CircleCNR(Center=escape_wheel_hub_2, Normal=Vector(0, 0, 1), Radius=division_4)

# ----
C = ClusterOutput(circle_3)

# ---- group: ANGLE OF ESCAPEMENT
# ANGLE OF ESCAPEMENT AS MEASURED FROM ESCAPE WHEEL HUB
Y = UnitY(Factor=1)
division_5 = Division(A=angle_of_escapement_2, B=2)
line = LineSDL(Start=escape_wheel_hub, Direction=Y, Length=division)
rad = Radians(Degrees=division_5)
neg = Negative(Value=rad)
rotate = Rotate(Geometry=line, Angle=[rad, neg], Plane=xy_plane)  # -> flatten(Geometry), Transform

# ---- group: ESCAPEMENT HUB LOCATION
# DRAW TANGENTS AT INTERSECTION OF TIP DIAMETER AND EXCAPEMENT ANGLES. INTERSECT TANGENTS FOR HUB LOCATION OF PALLET
multiplication = Multiplication(A=tip_diameter_of_escape_wheel_2, B=5)
ccx = CurveCurve(CurveA=circle, CurveB=rotate.Geometry)  # -> Points, flatten(ParamsA), ParamsB
item = ListItem(List=ccx.ParamsA, Index=0, Wrap=True)
item_2 = ListItem(List=ccx.ParamsA, Index=1, Wrap=True)
eval = EvaluateCurve(Curve=circle, Parameter=item_2)  # -> Point, Tangent, Angle
eval_2 = EvaluateCurve(Curve=circle, Parameter=item)  # -> Point, Tangent, Angle
neg_2 = Negative(Value=eval_2.Tangent)
line_2 = LineSDL(Start=eval_2.Point, Direction=neg_2, Length=multiplication)
line_3 = LineSDL(Start=eval.Point, Direction=eval.Tangent, Length=multiplication)
ccx_2 = CurveCurve(CurveA=line_3, CurveB=line_2)  # -> Points, ParamsA, ParamsB
xy = XYPlane(Origin=ccx_2.Points)

# ---- group: ANGULAR WIDTH OF ESCAPEMENT PALLET
degrees_of_impulse = Number(1)
division_6 = Division(A=division_3, B=2)
subtraction = Subtraction(A=division_6, B=degrees_of_impulse)

# ----
division_7 = Division(A=division_3, B=2)
rad_2 = Radians(Degrees=division_7)
rotate_2 = Rotate(Geometry=line, Angle=rad_2, Plane=xy_plane)  # -> Geometry, Transform

# ---- group: ESCAPEMENT PALLET WIDTH
division_8 = Division(A=subtraction, B=2)
rad_3 = Radians(Degrees=division_8)
neg_3 = Negative(Value=rad_3)
tip_diameter = Curve(circle)
item_3 = ListItem(List=rotate.Geometry, Index=0, Wrap=True)
item_4 = ListItem(List=rotate.Geometry, Index=0, Wrap=True)
rotate_3 = Rotate(Geometry=item_3, Angle=rad_3, Plane=xy_plane)  # -> Geometry, Transform
rotate_4 = Rotate(Geometry=item_4, Angle=neg_3, Plane=xy_plane)  # -> Geometry, Transform
ccx_3 = CurveCurve(CurveA=tip_diameter, CurveB=rotate_3.Geometry)  # -> Points, ParamsA, ParamsB
ccx_4 = CurveCurve(CurveA=tip_diameter, CurveB=rotate_4.Geometry)  # -> Points, ParamsA, ParamsB

# ----
rad_4 = Radians(Degrees=lock_angle_of_pallet_2)
rotate_5 = Rotate(Geometry=line, Angle=rad_4, Plane=xy_plane)  # -> Geometry, Transform

# ---- group: ESCAPEMENT PALLET WIDTH
item_5 = ListItem(List=rotate.Geometry, Index=1, Wrap=True)
item_6 = ListItem(List=rotate.Geometry, Index=1, Wrap=True)
rotate_6 = Rotate(Geometry=item_5, Angle=rad_3, Plane=xy_plane)  # -> Geometry, Transform
rotate_7 = Rotate(Geometry=item_6, Angle=neg_3, Plane=xy_plane)  # -> Geometry, Transform
ccx_5 = CurveCurve(CurveA=tip_diameter, CurveB=rotate_6.Geometry)  # -> Points, ParamsA, ParamsB
ccx_6 = CurveCurve(CurveA=tip_diameter, CurveB=rotate_7.Geometry)  # -> Points, ParamsA, ParamsB

# ---- group: CONSTRUCT TEETH
ccx_7 = CurveCurve(CurveA=line, CurveB=circle)  # -> Points, ParamsA, ParamsB
ccx_8 = CurveCurve(CurveA=rotate_5.Geometry, CurveB=circle)  # -> Points, ParamsA, ParamsB
ccx_9 = CurveCurve(CurveA=rotate_5.Geometry, CurveB=circle_2)  # -> Points, ParamsA, ParamsB
ccx_10 = CurveCurve(CurveA=rotate_2.Geometry, CurveB=circle_2)  # -> Points, ParamsA, ParamsB
ln = Line(StartPoint=ccx_7.Points, EndPoint=ccx_8.Points)
end = EndPoints(Curve=ln)  # -> Start, End
ln_2 = Line(StartPoint=end.Start, EndPoint=ccx_9.Points)
ln_3 = Line(StartPoint=end.End, EndPoint=ccx_10.Points)
join = JoinCurves(Curves=flatten([ln_2, ln_3, ln]), Preserve=False)
division_9 = Division(A=lock_angle_of_pallet_2, B=2)
arrpolar = PolarArray(Geometry=join, Plane=xy_plane, Count=escape_wheel_number_of_teeth_2, Angle=6.283185307)  # -> Geometry, Transform
rad_5 = Radians(Degrees=division_9)
neg_4 = Negative(Value=rad_5)
rotate_8 = Rotate(Geometry=arrpolar.Geometry, Angle=neg_4, Plane=PlaneXY(0, 0, 0))  # -> Geometry, Transform
shift = ShiftList(List=rotate_8.Geometry, Shift=1, Wrap=True)
end_2 = EndPoints(Curve=rotate_8.Geometry)  # -> flatten(Start), flatten(End)
end_3 = EndPoints(Curve=shift)  # -> flatten(Start), flatten(End)
ln_4 = Line(StartPoint=end_2.End, EndPoint=end_3.Start)
join_2 = JoinCurves(Curves=flatten([ln_4, rotate_8.Geometry]), Preserve=False)

# ---- group: ESCAPEMENT HUB
division_10 = Division(A=escapement_hub_diameter_2, B=2)
circle_4 = CircleCNR(Center=ccx_2.Points, Normal=Vector(0, 0, 1), Radius=division_10)
offset = Offset(Curve=circle_4, Distance=escapement_hub_offset_2, Plane=xy, Corners=1)

# ----
C_2 = ClusterOutput(circle_4)
C_3 = ClusterOutput(offset)
C_4 = ClusterOutput(join_2)

# ---- group: ESCAPEMENT FACES
dist = Distance(PointA=ccx_2.Points, PointB=ccx_3.Points)
dist_2 = Distance(PointA=ccx_2.Points, PointB=ccx_4.Points)
circle_5 = CircleCNR(Center=ccx_2.Points, Normal=Vector(0, 0, 1), Radius=dist)
circle_6 = CircleCNR(Center=ccx_2.Points, Normal=Vector(0, 0, 1), Radius=dist_2)

# ----
C_5 = ClusterOutput(circle_5)
C_6 = ClusterOutput(circle_6)

# ---- group: ENTRY PALLET
# LOCK AND IMPULSE ANGLE MEASURED FROM TIP DIAMETER TO CREATE LOCK AND IMPULSE FACES. - ENTRY PALLET
rad_6 = Radians(Degrees=lock_angle_of_pallet_2)
ln_5 = Line(StartPoint=ccx_2.Points, EndPoint=ccx_3.Points)
rotate_9 = Rotate(Geometry=ln_5, Angle=rad_6, Plane=xy)  # -> Geometry, Transform
rad_7 = Radians(Degrees=impulse_angle_of_pallet_2)
rotate_10 = Rotate(Geometry=rotate_9.Geometry, Angle=rad_7, Plane=xy)  # -> Geometry, Transform
ccx_11 = CurveCurve(CurveA=circle_5, CurveB=rotate_9.Geometry)  # -> Points, ParamsA, ParamsB
ccx_12 = CurveCurve(CurveA=circle_6, CurveB=rotate_10.Geometry)  # -> Points, ParamsA, ParamsB
ln_6 = Line(StartPoint=ccx_11.Points, EndPoint=ccx_12.Points)

# ---- group: EXIT PALLET
# IMPULSE ANGLE MEASURED FROM TIP DIAMETER TO CREATE IMPULSE FACE. - EXIT PALLET
rad_8 = Radians(Degrees=impulse_angle_of_pallet_2)
ln_7 = Line(StartPoint=ccx_2.Points, EndPoint=ccx_6.Points)
rotate_11 = Rotate(Geometry=ln_7, Angle=rad_8, Plane=xy)  # -> Geometry, Transform
ccx_13 = CurveCurve(CurveA=rotate_11.Geometry, CurveB=circle_6)  # -> Points, ParamsA, ParamsB
ln_8 = Line(StartPoint=ccx_13.Points, EndPoint=ccx_6.Points)

# ----
L = ClusterOutput(ln_8)
L_2 = ClusterOutput(ln_6)
